# Grasshopper definition defferential_growth.gh (Grasshopper 1.0.7)
# plug-ins: Kangaroo2 Components, Bifocals

# ---- group: RH_IN:count
number_slider = Slider(3, range=0..10)

# ---- group: RH_IN:radius
number_slider_2 = Slider(1.067, range=0.3..2)

# ----
circle = Circle(Plane=PlaneXY(0, 0, 0), Radius=Slider(40, range=0..100))
range = Range(Domain=Domain(0.1, 1), Steps=number_slider)

area = Area(Geometry=circle)  # -> Area, Centroid
scale = Scale(Geometry=circle, Center=area.Centroid, Factor=range)  # -> Geometry, Transform

segments_length = Slider(1.31, range=0.8..3)
curve = Curve(scale.Geometry)
len = Length(Curve=curve)
division = Division(A=len, B=segments_length)
divide = DivideCurve(Curve=curve, Count=division, Kinks=False)  # -> simplify(Points), Tangents, Parameters

vec = Vector(divide.Points)
amp = Amplitude(Vector=vec, Amplitude="0.15")
lng = ListLength(List=amp)
random = Random(Range="0 to 2*Pi", Number=lng, Seed=2)
rotate = Rotate(Geometry=amp, Angle=random, Plane=PlaneXY(0, 0, 0))  # -> simplify(Geometry), Transform

move = Move(Geometry=divide.Points, Motion=rotate.Geometry)  # -> Geometry, Transform
pline = PolyLine(Vertices=move.Geometry, Closed=Toggle(True))  # -> flatten(Polyline)
explode = Explode(Curve=pline, Recursive=True)  # -> Segments, Vertices
mesh_brep = MeshBrep(
    Brep=circle,
    Settings={GridMaxCount=0, GridMinCount=16, JaggedSeams=False, MaxEdgeLength=0, MinEdgeLength=1, MinTolerance=0, Refine=True, RefineAngle=0, RelativeTolerance=0.65, SimplePlanes=True, Tolerance=0})
asd = Asd(line=explode.Segments)  # -> line_4, int_3, int_4
cluster = Cluster(pt=move.Geometry)  # -> pt_4, int_3, int_4
shift = ShiftList(List=explode.Segments, Shift=1, Wrap=True)

length_line = LengthLine(Line=flatten(explode.Segments), Length=Slider(8.992, range=0..10), Strength="10")
angle = Angle(LineA=explode.Segments, LineB=shift, RestAngle="0", Strength="1500")
collider = Collider(Objects=cluster.pt_4, Radii=1, IgnoreA=cluster.int_3, IgnoreB=cluster.int_4, Strength="1000")
collider_2 = Collider(Objects=asd.line_4, Radii=number_slider_2, IgnoreA=asd.int_3, IgnoreB=asd.int_4, Strength="1000")
onmesh = OnMesh(Points=move.Geometry, Mesh=mesh_brep, Strength="2000")
show = Show(G=pline)

entwine = Entwine(
    Branch00=show,
    Branch01=onmesh,
    Branch02=length_line,
    Branch03=angle,
    Branch04=collider,
    Branch05=collider_2,
    FlattenInputs=True)
zombiesolver = ZombieSolver(GoalObjects=entwine, Threshold=1e-10, Tolerance=0.01, MaxIterations=Slider(202, range=0..1000))  # -> I, V, O
bang = ExplodeTree(Data=zombiesolver.O)  # -> Branch0, Branch1, Branch2, Branch3, Branch4, Branch5
crv = Curve(bang.Branch0)
cls = Closed(Curve=crv)  # -> Closed, Periodic
explode_2 = Explode(Curve=crv, Recursive=True)  # -> Segments, Vertices
intcrv = Interpolate(Vertices=explode_2.Vertices, Degree=3, Periodic=graft(cls.Closed), KnotStyle=1)  # -> flatten(Curve), Length, Domain
clean_tree = CleanTree(RemoveNulls=True, RemoveInvalid=True, RemoveEmpty=False, Tree=intcrv.Curve)
closed = Closed(Curve=clean_tree)  # -> Closed, Periodic
unit_z = UnitZ(Factor=Slider(8, range=0..100))
cull_pattern = CullPattern(List=flatten(clean_tree), CullPattern=closed.Closed)
extrude = Extrude(Base=cull_pattern, Direction=unit_z)
panel = Panel(cull_pattern)
curve_to_polyline = CurveToPolyline(Curve=cull_pattern, ToleranceDistance=0, ToleranceAngle=0, MinEdge=Slider(1, range=0..1))  # -> Polyline, Segments
mesh_surface = MeshSurface(Surface=extrude, UCount=Slider(5, range=0..1000), VCount=Slider(500, range=0..1000), Overhang=True, Equalize=False)
move_2 = Move(Geometry=curve_to_polyline.Polyline, Motion=unit_z)  # -> Geometry, Transform
mesh = Mesh(flatten(mesh_surface))
mesh_edges = MeshEdges(Mesh=mesh_surface)  # -> NakedEdges, InteriorEdges, NonManifoldEdges; disabled
deconstruct_mesh = DeconstructMesh(Mesh=mesh)  # -> Vertices, Faces, Colours, Normals
deconstruct = Deconstruct(Point=deconstruct_mesh.Vertices)  # -> XComponent, YComponent, ZComponent
bounds = Bounds(Numbers=flatten(deconstruct.ZComponent))
remap_numbers = RemapNumbers(Value=deconstruct.ZComponent, Source=bounds, Target=Domain(0, 1))  # -> Mapped, Clipped
graph_mapper = GraphMapper(
    remap_numbers.Mapped,
    x0=0,
    x1=1,
    y0=0,
    y1=1,
    container_name="Bezier",
    cpx=[0, 0.4490913749, 0.9366853237, 1],
    cpy=[0, 0.3764484525, 0.4134057164, 1])
gradient = Gradient(LowerLimit=0, UpperLimit=1, Parameter=graph_mapper, stops=[0.0206: RGB(10, 124, 255), 0.83: RGB(180, 237, 24)])
construct_mesh = ConstructMesh(Vertices=deconstruct_mesh.Vertices, Faces=deconstruct_mesh.Faces, Colours=gradient)

# ---- group: RH_OUT:edges
curve_2 = Curve(flatten([curve_to_polyline.Polyline, move_2.Geometry]))

# ---- group: RH_OUT:mesh
mesh_2 = Mesh(flatten(construct_mesh))

# ==== cluster Asd
line = ClusterInput()
line_2 = Line(line)
line_3 = Line(flatten(line_2))
lng = ListLength(List=line_3)
lng_2 = ListLength(List=line_2)  # -> flatten(Length)
series = Series(Start=0, Step=1, Count=lng)
line_4 = ClusterOutput(line_3)
partition = PartitionList(List=series, Size=lng_2)
shift = ShiftList(List=partition, Shift=1, Wrap=True)
int = Integer(flatten(partition))
int_2 = Integer(flatten(shift))
int_3 = ClusterOutput(int)
int_4 = ClusterOutput(int_2)

# ==== cluster Cluster
pt = ClusterInput()
pt_2 = Point(pt)
pt_3 = Point(flatten(pt_2))
lng = ListLength(List=pt_3)
lng_2 = ListLength(List=pt_2)  # -> flatten(Length)
series = Series(Start=0, Step=1, Count=lng)
pt_4 = ClusterOutput(pt_3)
partition = PartitionList(List=series, Size=lng_2)
shift = ShiftList(List=partition, Shift=1, Wrap=True)
int = Integer(flatten(partition))
int_2 = Integer(flatten(shift))
int_3 = ClusterOutput(int)
int_4 = ClusterOutput(int_2)
